# Grasshopper definition week5_loading_data_from_app.gh (Grasshopper 1.0.8)
# plug-ins: gHowl, Bifocals

udp_receiver = UDPReceiver(Port=Slider(5005, range=0..10000), Pattern=0)  # -> Info, Data
panel = Panel(udp_receiver.Data)

python_3_script = Python3Script(input_json=udp_receiver.Data, Scale=Slider(1, range=0..1), Reset=Toggle(False))  # -> out, P, H, V; inputs input_json: String, Scale: Double, Reset: Boolean
# ---------- python_3_script: Python ----------
# Inputs:
#   input_json : string (UDP Receiver의 JSON 문자열)
#   Scale : number (속도 배율)
#   Reset : bool (원점으로 리셋)
#
# Outputs:
#   P : point (이동하는 점)
#   H : heading (deg)
#   V : speed (m/s)
#   Dt : delta time (s)

import json
import math
import Rhino.Geometry as rg

if 'state' not in globals():
    state = {
        'pt': rg.Point3d(0, 0, 0),
        'last_ts': None
    }

P = state['pt']
H = 0.0
V = 0.0
Dt = 0.0

try:
    data = json.loads(input_json)
    ts = data.get('ts')
    derived = data.get('derived', {})
    headingRad = derived.get('headingRad', 0.0) or 0.0
    speedMs = derived.get('speedMs', 0.0) or 0.0

    # 시간 차이 계산
    if isinstance(ts, (int, float)):
        if state['last_ts'] is None:
            Dt = 0.0
        else:
            Dt = max(0.0, (ts - state['last_ts']) / 1000.0)
        state['last_ts'] = ts

    # Heading → 방향 벡터 (0 rad = +Y)
    dirX = math.sin(headingRad)
    dirY = math.cos(headingRad)
    dirZ = 0.0

    # 이동 거리 = 속도 * 시간 * 배율
    moveDist = (speedMs or 0.0) * (Dt or 0.0) * (Scale or 1.0)
    moveVec = rg.Vector3d(dirX * moveDist, dirY * moveDist, dirZ * moveDist)

    if Reset:
        state['pt'] = rg.Point3d(0, 0, 0)
    else:
        state['pt'].Transform(rg.Transform.Translation(moveVec))

    P = state['pt']
    H = math.degrees(headingRad)
    V = speedMs

except Exception as e:
    pass
# ---------- end python_3_script ----------
point = Point(python_3_script.P)
panel_2 = Panel(python_3_script.P)
panel_3 = Panel(python_3_script.H)
panel_4 = Panel(python_3_script.V)
